# Grasshopper definition colorlength3.gh (Grasshopper 0.9.76)
# plug-ins: MeshMachine, PlanktonGh, Weaverbird

mesh = Mesh(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)
mesh_2 = Mesh(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)
crv = Curve([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])
pt = Point([Point(37.07953644, 41.41840744, 0), Point(0, 41.41840744, 0), Point(0, -0.6050662994, 0), Point(37.07953644, -0.6050662994, 0)])
dom = ConstructDomain(DomainStart=Slider(0.16, range=0.1..1), DomainEnd=Slider(1, range=0.2..1))
c_script = CSharpScript(
    Map=dom,
    M=mesh,
    Reference=["C:\Users\Daniel\AppData\Roaming\Grasshopper\Libraries\remesher.gha", "C:\Users\Daniel\AppData\Roaming\Grasshopper\Libraries\Plankton.dll", "C:\Users\Daniel\AppData\Roaming\Grasshopper\Libraries\PlanktonGh.dll"])  # -> out, A; inputs M: Mesh
# ---------- c_script: C# ----------
    A = new TargetLength(M, Map);
# ---------- c_script: C# additional code ----------
  public class TargetLength : ITargetLength
  {
    private Mesh M;
    private Interval Map;
    public TargetLength(Mesh m, Interval Inter)
    {
      M = m;
      Map = Inter;
    }
    public double Calculate(PlanktonMesh P, int HE)
    {
      var Ends = P.Halfedges.GetVertices(HE);

      Point3d MidPt = new Point3d();
      MidPt = ( 0.5 *
        (PlanktonGh.RhinoSupport.ToPoint3d(P.Vertices[Ends[0]])
        +
        PlanktonGh.RhinoSupport.ToPoint3d(P.Vertices[Ends[1]])
        ));

      return Map.T0 +
        (ColorAt(M, M.ClosestMeshPoint(MidPt, 100)).R / 255.0)
        * (Map.T1 - Map.T0);

    }
  }


  //There's a bug in Rhino's Mesh.ColorAt, so here is a replacement:

  public static Color ColorAt(Mesh mesh, int faceIndex, double t0, double t1, double t2, double t3)
  {
    var color = Rhino.Display.Color4f.Black;

    if( mesh.VertexColors.Count != 0)
    {

      if( faceIndex >= 0 && faceIndex < mesh.Faces.Count )
      {
        MeshFace face = mesh.Faces[faceIndex];

        // Collect data for barycentric evaluation.
        Color p0, p1, p2;

        if(face.IsTriangle)
        {
          p0 = mesh.VertexColors[face.A];
          p1 = mesh.VertexColors[face.B];
          p2 = mesh.VertexColors[face.C];
        }
        else
        {
          if( t3 == 0 )
          { // point is on subtriangle {0,1,2}
            p0 = mesh.VertexColors[face.A];
            p1 = mesh.VertexColors[face.B];
            p2 = mesh.VertexColors[face.C];
          }
          else if( t1 == 0 )
          { // point is on subtriangle {0,2,3}
            p0 = mesh.VertexColors[face.A];
            p1 = mesh.VertexColors[face.C];
            p2 = mesh.VertexColors[face.D];
            //t0 = t0;
            t1 = t2;
            t2 = t3;
          }
          else if( t2 == -1 )
          { // point is on subtriangle {0,1,3}
            p0 = mesh.VertexColors[face.A];
            p1 = mesh.VertexColors[face.B];
            p2 = mesh.VertexColors[face.D];
            //t0 = t0;
            //t1 = t1;
            t2 = t3;
          }
          else
          { // point must be on remaining subtriangle {1,2,3}
            p0 = mesh.VertexColors[face.B];
            p1 = mesh.VertexColors[face.C];
            p2 = mesh.VertexColors[face.D];
            t0 = t1;
            t1 = t2;
            t2 = t3;
          }
        }

        var c0 = new Rhino.Display.Color4f(p0);
        var c1 = new Rhino.Display.Color4f(p1);
        var c2 = new Rhino.Display.Color4f(p2);
        float s0 = (float) t0;
        float s1 = (float) t1;
        float s2 = (float) t2;

        float R = s0 * c0.R + s1 * c1.R + s2 * c2.R;
        float G = s0 * c0.G + s1 * c1.G + s2 * c2.G;
        float B = s0 * c0.B + s1 * c1.B + s2 * c2.B;
        color = new Rhino.Display.Color4f(R, G, B, 1);
      }
    }
    return color.AsSystemColor();

  }

  public static Color ColorAt(Mesh mesh, MeshPoint meshPoint)
  {
    return ColorAt(mesh, meshPoint.FaceIndex, meshPoint.T[0], meshPoint.T[1], meshPoint.T[2], meshPoint.T[3]);
  }
# ---------- end c_script ----------
timer = Timer(TimerInterval=20, Target=remesher)  # disabled
remesher = Remesher(
    Geometry=mesh_2,
    TargetLengthFunction=c_script.A,
    FixCurves=crv,
    FixVertices=pt,
    Flip=1,
    PullStrength=0.8,
    Iterations=1,
    Reset=Toggle(True))
pmesh = PlanktonMesh(remesher)
mesh_3 = Mesh(pmesh)
demesh = DeconstructMesh(Mesh=mesh_3)  # -> Vertices, Faces, Colours, Normals
wbdual = WeaverbirdsDualGraph(MeshCurves=mesh_3, DualMode=0)  # disabled
cir = Circle(Plane=demesh.Vertices, Radius=0.06)
