# Grasshopper definition relocate.gh (Grasshopper 0.9.76)
# plug-ins: MeshMachine, PlanktonGh

mesh = Mesh(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)
mesh_2 = Mesh(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)
c_script = CSharpScript(Reference=["C:\Users\Daniel\AppData\Roaming\Grasshopper\Libraries\remesher.gha", "C:\Users\Daniel\AppData\Roaming\Grasshopper\Libraries\Plankton.dll", "C:\Users\Daniel\AppData\Roaming\Grasshopper\Libraries\PlanktonGh.dll"])  # -> out, A
# ---------- c_script: C# ----------
    A = new VertexMove();
# ---------- c_script: C# additional code ----------
  public class VertexMove : IVertexMove
  {
    public VertexMove()
    {
    }

    public List<Point3d> NewPositions(PlanktonMesh P, List<int> FeatureV, List<int> FeatureE, List<Point3d> FV, List<Curve> FC)
    {
      double smooth = 1.0;
      //double pull = 1.0;
      List<Point3d> temp = new List<Point3d>();
      for(int i = 0; i < P.Vertices.Count; i++)
      {
        temp.Add(P.Vertices[i].ToPoint3d());
      }

      Vector3d[] Smooth = LaplacianSmooth(P, 0, 1);

      for (int i = 0; i < P.Vertices.Count; i++)
      {
        if (FeatureV[i] == -1) // don't smooth feature vertices
        {
          // make it tangential only
          Vector3d VNormal = Normal(P, i);
          double ProjLength = Smooth[i] * VNormal;
          Smooth[i] = Smooth[i] - (VNormal * ProjLength);

          //P.Vertices.MoveVertex(i, Smooth[i]);
          temp[i] += Smooth[i];

          if (P.Vertices.NakedEdgeCount(i) != 0)//special smoothing for feature edges
          {
            int[] Neighbours = P.Vertices.GetVertexNeighbours(i);
            int ncount = 0;
            Point3d Avg = new Point3d();

            for (int j = 0; j < Neighbours.Length; j++)
            {
              if (P.Vertices.NakedEdgeCount(Neighbours[j]) != 0)
              {
                ncount++;
                Avg = Avg + P.Vertices[Neighbours[j]].ToPoint3d();
              }
            }
            Avg = Avg * (1.0 / ncount);
            Vector3d move = Avg - P.Vertices[i].ToPoint3d();
            move = move * 1;
            //P.Vertices.MoveVertex(i, move);
            temp[i] += move;
          }

          if (FeatureV[i] != -1)//special smoothing for feature edges
          {
            int[] Neighbours = P.Vertices.GetVertexNeighbours(i);
            int ncount = 0;
            Point3d Avg = new Point3d();

            for (int j = 0; j < Neighbours.Length; j++)
            {
              if (FeatureV[Neighbours[j]] == FeatureV[i])// || (AnchorV[Neighbours[j]] != -1))
              {
                ncount++;
                Avg = Avg + P.Vertices[Neighbours[j]].ToPoint3d();
              }
            }
            Avg = Avg * (1.0 / ncount);
            Vector3d move = Avg - P.Vertices[i].ToPoint3d();
            move = move * smooth;
            //P.Vertices.MoveVertex(i, move);
            temp[i] += move;
          }

          //projecting points onto the target along their normals

          //          if (pull > 0)
          //          {
          //            Point3d Point = P.Vertices[i].ToPoint3d();
          //            Vector3d normal = Normal(P, i);
          //            Ray3d Ray1 = new Ray3d(Point, normal);
          //            Ray3d Ray2 = new Ray3d(Point, -normal);
          //            double RayPt1 = Rhino.Geometry.Intersect.Intersection.MeshRay(M, Ray1);
          //            double RayPt2 = Rhino.Geometry.Intersect.Intersection.MeshRay(M, Ray2);
          //            Point3d ProjectedPt;
          //
          //            if ((RayPt1 < RayPt2) && (RayPt1 > 0) && (RayPt1 < 1.0))
          //            {
          //              ProjectedPt = Point * (1 - pull) + pull * Ray1.PointAt(RayPt1);
          //            }
          //            else if ((RayPt2 < RayPt1) && (RayPt2 > 0) && (RayPt2 < 1.0))
          //            {
          //              ProjectedPt = Point * (1 - pull) + pull * Ray2.PointAt(RayPt2);
          //            }
          //            else
          //            {
          //              ProjectedPt = Point * (1 - pull) + pull * M.ClosestPoint(Point);
          //            }
          //
          //            //P.Vertices.SetVertex(i, ProjectedPt);
          //            temp[i] = ProjectedPt;
          //          }


          if (FeatureV[i] != -1) //pull feature vertices onto feature curves
          {
            Point3d Point = P.Vertices[i].ToPoint3d();
            Curve CF = FC[FeatureV[i]];
            double param1 = 0.0;
            Point3d onFeature = new Point3d();
            CF.ClosestPoint(Point, out param1);
            onFeature = CF.PointAt(param1);
            //P.Vertices.SetVertex(i, onFeature);
            temp[i] = onFeature;
          }
        }
        else
        {
          //P.Vertices.SetVertex(i, FV[AnchorV[i]]); //pull anchor vertices onto their points

        }
      }




      return temp;
    }
  }

  public static Vector3d[] LaplacianSmooth(PlanktonMesh P, int W, double Strength)
  {
    int VertCount = P.Vertices.Count;
    Vector3d[] Smooth = new Vector3d[VertCount];

    for (int i = 0; i < VertCount; i++)
    {
      if ((P.Vertices[i].IsUnused == false) && (P.Vertices.IsBoundary(i) == false))
      {
        int[] Neighbours = P.Vertices.GetVertexNeighbours(i);
        Point3d Vertex = P.Vertices[i].ToPoint3d();
        Point3d Centroid = new Point3d();
        if (W == 0)
        {
          for (int j = 0; j < Neighbours.Length; j++)
          { Centroid = Centroid + P.Vertices[Neighbours[j]].ToPoint3d(); }
          Smooth[i] = ((Centroid * (1.0 / P.Vertices.GetValence(i))) - Vertex) * Strength;
        }
        if (W == 1)
        {
          //get the radial vectors of the 1-ring
          //get the vectors around the 1-ring
          //get the cotangent weights for each edge

          int valence = Neighbours.Length;

          Point3d[] NeighbourPts = new Point3d[valence];
          Vector3d[] Radial = new Vector3d[valence];
          Vector3d[] Around = new Vector3d[valence];
          double[] CotWeight = new double[valence];
          double WeightSum = 0;

          for (int j = 0; j < valence; j++)
          {
            NeighbourPts[j] = P.Vertices[Neighbours[j]].ToPoint3d();
            Radial[j] = NeighbourPts[j] - Vertex;
          }

          for (int j = 0; j < valence; j++)
          {
            Around[j] = NeighbourPts[(j + 1) % valence] - NeighbourPts[j];
          }

          for (int j = 0; j < Neighbours.Length; j++)
          {
            //get the cotangent weights
            int previous = (j + valence - 1) % valence;
            Vector3d Cross1 = Vector3d.CrossProduct(Radial[previous], Around[previous]);
            double Cross1Length = Cross1.Length;
            double Dot1 = Radial[previous] * Around[previous];

            int next = (j + 1) % valence;
            Vector3d Cross2 = Vector3d.CrossProduct(Radial[next], Around[j]);
            double Cross2Length = Cross2.Length;
            double Dot2 = Radial[next] * Around[j];

            CotWeight[j] = Math.Abs(Dot1 / Cross1Length) + Math.Abs(Dot2 / Cross2Length);
            WeightSum += CotWeight[j];
          }

          double InvWeightSum = 1.0 / WeightSum;

          Vector3d ThisSmooth = new Vector3d();

          for (int j = 0; j < Neighbours.Length; j++)
          {
            ThisSmooth = ThisSmooth + Radial[j] * CotWeight[j];
          }

          Smooth[i] = ThisSmooth * InvWeightSum * Strength;
        }

      }
    }
    return Smooth;
  }

  public static Vector3d Normal(PlanktonMesh P, int V)
  {
    Point3d Vertex = P.Vertices[V].ToPoint3d();
    Vector3d Norm = new Vector3d();

    int[] OutEdges = P.Vertices.GetHalfedges(V);
    int[] Neighbours = P.Vertices.GetVertexNeighbours(V);
    Vector3d[] OutVectors = new Vector3d[Neighbours.Length];
    int Valence = P.Vertices.GetValence(V);

    for (int j = 0; j < Valence; j++)
    {
      OutVectors[j] = P.Vertices[Neighbours[j]].ToPoint3d() - Vertex;
    }

    for (int j = 0; j < Valence; j++)
    {
      if (P.Halfedges[OutEdges[(j + 1) % Valence]].AdjacentFace != -1)
      {
        Norm += (Vector3d.CrossProduct(OutVectors[(j + 1) % Valence], OutVectors[j]));
      }
    }

    Norm.Unitize();
    return Norm;
  }
# ---------- end c_script ----------
crv = Curve([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])
pt = Point([Point(37.07953644, 41.41840744, 0), Point(0, 41.41840744, 0), Point(0, -0.6050662994, 0), Point(37.07953644, -0.6050662994, 0)])
dom = ConstructDomain(DomainStart=Slider(0.16, range=0.1..1), DomainEnd=Slider(1, range=0.2..1))
c_script_2 = CSharpScript(
    Map=dom,
    M=mesh,
    Reference=["C:\Users\Daniel\AppData\Roaming\Grasshopper\Libraries\remesher.gha", "C:\Users\Daniel\AppData\Roaming\Grasshopper\Libraries\Plankton.dll", "C:\Users\Daniel\AppData\Roaming\Grasshopper\Libraries\PlanktonGh.dll"])  # -> out, A; inputs M: Mesh
# ---------- c_script_2: C# ----------
    A = new TargetLength(M, Map);
# ---------- c_script_2: C# additional code ----------
  public class TargetLength : ITargetLength
  {
    private Mesh M;
    private Interval Map;
    public TargetLength(Mesh m, Interval Inter)
    {
      M = m;
      Map = Inter;
    }
    public double Calculate(PlanktonMesh P, int HE)
    {
      var Ends = P.Halfedges.GetVertices(HE);

      Point3d MidPt = new Point3d();
      MidPt = ( 0.5 *
        (PlanktonGh.RhinoSupport.ToPoint3d(P.Vertices[Ends[0]])
        +
        PlanktonGh.RhinoSupport.ToPoint3d(P.Vertices[Ends[1]])
        ));

      return Map.T0 +
        (ColorAt(M, M.ClosestMeshPoint(MidPt, 100)).R / 255.0)
        * (Map.T1 - Map.T0);

    }
  }


  //There's a bug in Rhino's Mesh.ColorAt, so here is a replacement:

  public static Color ColorAt(Mesh mesh, int faceIndex, double t0, double t1, double t2, double t3)
  {
    var color = Rhino.Display.Color4f.Black;

    if( mesh.VertexColors.Count != 0)
    {

      if( faceIndex >= 0 && faceIndex < mesh.Faces.Count )
      {
        MeshFace face = mesh.Faces[faceIndex];

        // Collect data for barycentric evaluation.
        Color p0, p1, p2;

        if(face.IsTriangle)
        {
          p0 = mesh.VertexColors[face.A];
          p1 = mesh.VertexColors[face.B];
          p2 = mesh.VertexColors[face.C];
        }
        else
        {
          if( t3 == 0 )
          { // point is on subtriangle {0,1,2}
            p0 = mesh.VertexColors[face.A];
            p1 = mesh.VertexColors[face.B];
            p2 = mesh.VertexColors[face.C];
          }
          else if( t1 == 0 )
          { // point is on subtriangle {0,2,3}
            p0 = mesh.VertexColors[face.A];
            p1 = mesh.VertexColors[face.C];
            p2 = mesh.VertexColors[face.D];
            //t0 = t0;
            t1 = t2;
            t2 = t3;
          }
          else if( t2 == -1 )
          { // point is on subtriangle {0,1,3}
            p0 = mesh.VertexColors[face.A];
            p1 = mesh.VertexColors[face.B];
            p2 = mesh.VertexColors[face.D];
            //t0 = t0;
            //t1 = t1;
            t2 = t3;
          }
          else
          { // point must be on remaining subtriangle {1,2,3}
            p0 = mesh.VertexColors[face.B];
            p1 = mesh.VertexColors[face.C];
            p2 = mesh.VertexColors[face.D];
            t0 = t1;
            t1 = t2;
            t2 = t3;
          }
        }

        var c0 = new Rhino.Display.Color4f(p0);
        var c1 = new Rhino.Display.Color4f(p1);
        var c2 = new Rhino.Display.Color4f(p2);
        float s0 = (float) t0;
        float s1 = (float) t1;
        float s2 = (float) t2;

        float R = s0 * c0.R + s1 * c1.R + s2 * c2.R;
        float G = s0 * c0.G + s1 * c1.G + s2 * c2.G;
        float B = s0 * c0.B + s1 * c1.B + s2 * c2.B;
        color = new Rhino.Display.Color4f(R, G, B, 1);
      }
    }
    return color.AsSystemColor();

  }

  public static Color ColorAt(Mesh mesh, MeshPoint meshPoint)
  {
    return ColorAt(mesh, meshPoint.FaceIndex, meshPoint.T[0], meshPoint.T[1], meshPoint.T[2], meshPoint.T[3]);
  }
# ---------- end c_script_2 ----------
panel = Panel(c_script.out)
timer = Timer(TimerInterval=20, Target=remesher)  # disabled
remesher = Remesher(
    Geometry=mesh_2,
    TargetLengthFunction=c_script_2.A,
    VertexMoveFunction=c_script.A,
    FixCurves=crv,
    FixVertices=pt,
    Flip=1,
    Iterations=1,
    Reset=Toggle(False))
pmesh = PlanktonMesh(remesher)
mesh_3 = Mesh(pmesh)
