# Grasshopper definition relocatebreak.gh (Grasshopper 0.9.76)
# plug-ins: Python Interpreter, MeshMachine, Kangaroo Components, PlanktonGh, HDTReference, Weaverbird

mesh = Mesh(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)
mesh_2 = Mesh(mesh)
wbnaked = WeaverbirdsNakedBoundary(MeshClosedPolylines=mesh_2)
brep = Brep(<brep referenced from the Rhino model>)
number_slider = Slider(7, range=0..10)
simplify = SimplifyCurve(Curve=wbnaked)  # -> Curve, Simplified
B = Base({Plane=PlaneXY(-1.225136256, 4.083362321, 0), X=Domain(0, 6.240353293), Y=Domain(0, 6.224927522), Z=Domain(0, 6.224927522)})
mesh_3 = Mesh(<mesh referenced from the Rhino model>)
explode = Explode(Curve=simplify.Curve, Recursive=True)  # -> Segments, Vertices
c_script = CSharpScript(
    M=mesh_2,
    Reference=["C:\USERS\WPEAR\APPDATA\ROAMING\GRASSHOPPER\LIBRARIES\remesher.gha", "C:\USERS\WPEAR\APPDATA\ROAMING\GRASSHOPPER\LIBRARIES\Plankton.dll", "C:\USERS\WPEAR\APPDATA\ROAMING\GRASSHOPPER\LIBRARIES\PlanktonGh.dll"])  # -> out, A; inputs M: Mesh
# ---------- c_script: C# ----------
    A = new VertexMove(M);
# ---------- c_script: C# additional code ----------
  public class VertexMove : IVertexMove
  {
    Mesh M = new Mesh();
    public VertexMove(Mesh m)
    {
      M = m;
    }

    public List<Point3d> NewPositions(PlanktonMesh P)
    {
      List<Point3d> temp = new List<Point3d>();
      for(int i = 0; i < P.Vertices.Count; i++)
      {
        temp.Add(P.Vertices[i].ToPoint3d());
      }

      Vector3d[] Smooth = LaplacianSmooth(P, 0, 1);

      for (int i = 0; i < P.Vertices.Count; i++)
      {

        // make it tangential only
        Vector3d VNormal = Normal(P, i);
        double ProjLength = Smooth[i] * VNormal;
        Smooth[i] = Smooth[i] - (VNormal * ProjLength);

        temp[i] += Smooth[i];

        //projecting points onto the target along their normals
        {
          Point3d Point = P.Vertices[i].ToPoint3d();
          Point = temp[i];
          Vector3d normal = Normal(P, i);
          Ray3d Ray1 = new Ray3d(Point, normal);
          Ray3d Ray2 = new Ray3d(Point, -normal);
          double RayPt1 = Rhino.Geometry.Intersect.Intersection.MeshRay(M, Ray1);
          double RayPt2 = Rhino.Geometry.Intersect.Intersection.MeshRay(M, Ray2);
          Point3d ProjectedPt;

          if ((RayPt1 < RayPt2) && (RayPt1 > 0) && (RayPt1 < 1.0))
          {
            ProjectedPt = Ray1.PointAt(RayPt1);
          }
          else if ((RayPt2 < RayPt1) && (RayPt2 > 0) && (RayPt2 < 1.0))
          {
            ProjectedPt = Ray2.PointAt(RayPt2);
          }
          else
          {
            ProjectedPt = M.ClosestPoint(Point);
          }

          //P.Vertices.SetVertex(i, ProjectedPt);
          temp[i] = ProjectedPt;
        }




      }




      return temp;
    }
  }


  public static Vector3d[] LaplacianSmooth(PlanktonMesh P, int W, double Strength)
  {
    int VertCount = P.Vertices.Count;
    Vector3d[] Smooth = new Vector3d[VertCount];

    for (int i = 0; i < VertCount; i++)
    {
      if ((P.Vertices[i].IsUnused == false) && (P.Vertices.IsBoundary(i) == false))
      {
        int[] Neighbours = P.Vertices.GetVertexNeighbours(i);
        Point3d Vertex = P.Vertices[i].ToPoint3d();
        Point3d Centroid = new Point3d();
        if (W == 0)
        {
          for (int j = 0; j < Neighbours.Length; j++)
          { Centroid = Centroid + P.Vertices[Neighbours[j]].ToPoint3d(); }
          Smooth[i] = ((Centroid * (1.0 / P.Vertices.GetValence(i))) - Vertex) * Strength;
        }
        if (W == 1)
        {
          //get the radial vectors of the 1-ring
          //get the vectors around the 1-ring
          //get the cotangent weights for each edge

          int valence = Neighbours.Length;

          Point3d[] NeighbourPts = new Point3d[valence];
          Vector3d[] Radial = new Vector3d[valence];
          Vector3d[] Around = new Vector3d[valence];
          double[] CotWeight = new double[valence];
          double WeightSum = 0;

          for (int j = 0; j < valence; j++)
          {
            NeighbourPts[j] = P.Vertices[Neighbours[j]].ToPoint3d();
            Radial[j] = NeighbourPts[j] - Vertex;
          }

          for (int j = 0; j < valence; j++)
          {
            Around[j] = NeighbourPts[(j + 1) % valence] - NeighbourPts[j];
          }

          for (int j = 0; j < Neighbours.Length; j++)
          {
            //get the cotangent weights
            int previous = (j + valence - 1) % valence;
            Vector3d Cross1 = Vector3d.CrossProduct(Radial[previous], Around[previous]);
            double Cross1Length = Cross1.Length;
            double Dot1 = Radial[previous] * Around[previous];

            int next = (j + 1) % valence;
            Vector3d Cross2 = Vector3d.CrossProduct(Radial[next], Around[j]);
            double Cross2Length = Cross2.Length;
            double Dot2 = Radial[next] * Around[j];

            CotWeight[j] = Math.Abs(Dot1 / Cross1Length) + Math.Abs(Dot2 / Cross2Length);
            WeightSum += CotWeight[j];
          }

          double InvWeightSum = 1.0 / WeightSum;

          Vector3d ThisSmooth = new Vector3d();

          for (int j = 0; j < Neighbours.Length; j++)
          {
            ThisSmooth = ThisSmooth + Radial[j] * CotWeight[j];
          }

          Smooth[i] = ThisSmooth * InvWeightSum * Strength;
        }

      }
    }
    return Smooth;
  }

  public static Vector3d Normal(PlanktonMesh P, int V)
  {
    Point3d Vertex = P.Vertices[V].ToPoint3d();
    Vector3d Norm = new Vector3d();

    int[] OutEdges = P.Vertices.GetHalfedges(V);
    int[] Neighbours = P.Vertices.GetVertexNeighbours(V);
    Vector3d[] OutVectors = new Vector3d[Neighbours.Length];
    int Valence = P.Vertices.GetValence(V);

    for (int j = 0; j < Valence; j++)
    {
      OutVectors[j] = P.Vertices[Neighbours[j]].ToPoint3d() - Vertex;
    }

    for (int j = 0; j < Valence; j++)
    {
      if (P.Halfedges[OutEdges[(j + 1) % Valence]].AdjacentFace != -1)
      {
        Norm += (Vector3d.CrossProduct(OutVectors[(j + 1) % Valence], OutVectors[j]));
      }
    }

    Norm.Unitize();
    return Norm;
  }
# ---------- end c_script ----------
duppt = RemoveDuplicatePts(Points=explode.Vertices, Tolerance=0.01)
mbox = MeshBox(Base=B, XCount=10, YCount=10, ZCount=10)
c_script_2 = CSharpScript(
    x=Slider(6.026, range=0..10),
    Reference=["C:\Users\wpear\AppData\Roaming\Grasshopper\Libraries\remesher.gha", "C:\Users\wpear\AppData\Roaming\Grasshopper\Libraries\Plankton.dll", "C:\Users\wpear\AppData\Roaming\Grasshopper\Libraries\Plankton.gha"])  # -> out, A; inputs x: Double
# ---------- c_script_2: C# ----------
    A = new TargetLength(x);
# ---------- c_script_2: C# additional code ----------
  public class TargetLength : ITargetLength
  {

    double Length;
    public TargetLength(double x)
    {
      Length = x;
    }
    public double Calculate(PlanktonMesh P, int HE)
    {
      return Length;
    }
  }
# ---------- end c_script_2 ----------
brep_2 = Brep(mbox)
panel = Panel(c_script.out)
timer = Timer(TimerInterval=20, Target=remesher)  # disabled
remesher = Remesher(
    Geometry=mesh_2,
    TargetLengthFunction=c_script_2.A,
    VertexMoveFunction=c_script.A,
    FixCurves=explode.Segments,
    FixVertices=duppt,
    Flip=1,
    Iterations=1,
    Reset=Toggle(True))
pmesh = PlanktonMesh(remesher)
medges = MeshEdges(Mesh=pmesh)  # -> NakedEdges, InteriorEdges, NonManifoldEdges
mesh_4 = Mesh(pmesh)
deconstructplankton = DeconstructPlankton(PMesh=remesher)  # -> Vertex_Points, Vertex_Outgoing_Halfedge, Halfedge_StartVertex, Halfedge_AdjacentFace, Halfedge_NextHalfedge, Halfedge_PrevHalfedge, Halfedge_Pair, Face_Halfedge
python = PythonScript(x=remesher)  # -> out, a
# ---------- python: Python ----------
import clr
clr.AddReferenceToFile("Plankton.dll")

import Plankton

mesh = Plankton.PlanktonMesh(x)

boundary = []

for index in range(mesh.Vertices.Count):
    """
    b = False
    for h in mesh.Halfedges.GetVertexCirculator(index):
        #print mesh.Halfedges[h].AdjacentFace
        if mesh.Halfedges[h].AdjacentFace < 0:
            b = True
            break
    boundary.append(b)
    """
    hs = mesh.Vertices.GetHalfedges(index)
    adj = [mesh.Halfedges[h].AdjacentFace for h in hs]
    boundary.append(-1 in adj)

a = boundary
# ---------- end python ----------
item = ListItem(List=deconstructplankton.Halfedge_AdjacentFace, Index=deconstructplankton.Vertex_Outgoing_Halfedge, Wrap=True)
item_2 = ListItem(List=deconstructplankton.Halfedge_Pair, Index=deconstructplankton.Vertex_Outgoing_Halfedge, Wrap=True)
smaller = SmallerThan(FirstNumber=item, SecondNumber="0")  # -> SmallerThan, OrEqualTo
ma = MassAddition(Input=python.a)  # -> Result, PartialResults
item_3 = ListItem(List=deconstructplankton.Halfedge_StartVertex, Index=item_2, Wrap=True)
dispatch = Dispatch(List=deconstructplankton.Vertex_Points, DispatchPattern=python.a)  # -> ListA, ListB
item_4 = ListItem(List=deconstructplankton.Vertex_Points, Index=item_3, Wrap=True)
vec2pt = Vector2Pt(PointA=deconstructplankton.Vertex_Points, PointB=item_4, Unitize=False)  # -> Vector, Length
dispatch_2 = Dispatch(List=vec2pt.Vector, DispatchPattern=python.a)  # -> ListA, ListB
pt = Point(dispatch.ListA)
points = PointList(Points=dispatch.ListA, Size=0.1)
vdis = VectorDisplay(Anchor=dispatch.ListA, Vector=dispatch_2.ListA)
line = LineSDL(Start=dispatch.ListA, Direction=dispatch_2.ListA, Length=dispatch_2.ListA)
previewlw = CustomPreviewLineweights(Geometry=line, Shader=ColourSwatch(SwatchColor=RGB(128, 255, 0)), Thickness=3)
